# Grasshopper definition 20170930_りんごのコンペのモデル.gh (Grasshopper 0.9.76)

スパン = Panel("0.010546")
multiplication = Multiplication(A=スパン, B=Slider(0.8, range=0..1))
range = Range(Domain=Slider(58, range=0..100), Steps=Slider(5500, range=0..6000))
number_slider = Slider(1, range=0..5)
addition = Addition(A=range, B=multiplication)
expression = Expression(u=addition, v=number_slider, Expression="-15000*cos(u*v)")
panel = Panel(addition)
expression_2 = Expression(u=addition, v=number_slider, Expression="15000*sin(u*v)")
expression_3 = Expression(u=addition, v="1.4", Expression="0.0006*(u-30)^2-v")
expression_4 = Expression(u=addition, v="1.05", Expression="-0.38")
multiplication_2 = Multiplication(A=panel, B="548")
panel_2 = Panel(expression_4)
panel_3 = Panel(expression_3)
panel_4 = Panel(multiplication_2)
multiplication_3 = Multiplication(A=panel_3, B=expression)
multiplication_4 = Multiplication(A=panel_3, B=expression_2)
multiplication_5 = Multiplication(A=panel_2, B=expression)
multiplication_6 = Multiplication(A=panel_2, B=expression_2)
pt = ConstructPoint(XCoordinate=multiplication_4, YCoordinate=multiplication_3, ZCoordinate=panel_4)  # disabled
panel_5 = Panel(pt)
pt_2 = ConstructPoint(XCoordinate=multiplication_6, YCoordinate=multiplication_5, ZCoordinate=panel_4)  # disabled
panel_6 = Panel(pt_2)

number_slider_2 = Slider(1, range=0..5)  # disabled
number_slider_3 = Slider(58, range=0..100)  # disabled
number_slider_4 = Slider(5500, range=0..6000)  # disabled
panel_7 = Panel("1.05")  # disabled
panel_8 = Panel("1.4")  # disabled
range_2 = Range(Domain=number_slider_3, Steps=number_slider_4)  # disabled
panel_9 = Panel("螺旋スロープは10回転")  # disabled
expression_5 = Expression(u=range_2, v=number_slider_2, Expression="-15000*cos(u*v)")  # disabled
expression_6 = Expression(u=range_2, v=number_slider_2, Expression="15000*sin(u*v)")  # disabled
expression_7 = Expression(u=range_2, v=panel_8, Expression="0.0006*(u-30)^2-v")  # disabled
panel_10 = Panel(range_2)  # disabled
panel_11 = Panel("""螺旋スロープの高さは32000mm
各層の高さは3500mm""")  # disabled
panel_12 = Panel("548")  # disabled
expression_8 = Expression(u=range_2, v=panel_7, Expression="-0.38")  # disabled
panel_13 = Panel("""螺旋スロープの外周が12600mm
内周は7500mm""")  # disabled
multiplication_7 = Multiplication(A=panel_10, B=panel_12)  # disabled
panel_14 = Panel("0,0,0")  # disabled
panel_15 = Panel("0,0,40000")  # disabled
number_slider_5 = Slider(0.008, range=0..10)  # disabled
panel_16 = Panel(multiplication_7)  # disabled
panel_17 = Panel(expression_8)  # disabled
panel_18 = Panel(expression_7)  # disabled
ln = Line(StartPoint=panel_14, EndPoint=panel_15)  # disabled
multiplication_8 = Multiplication(A=panel_18, B=expression_5)  # disabled
multiplication_9 = Multiplication(A=panel_18, B=expression_6)  # disabled
multiplication_10 = Multiplication(A=panel_17, B=expression_5)  # disabled
multiplication_11 = Multiplication(A=panel_17, B=expression_6)  # disabled
内周pt = ConstructPoint(XCoordinate=multiplication_11, YCoordinate=multiplication_10, ZCoordinate=panel_16)  # disabled
外周pt = ConstructPoint(XCoordinate=multiplication_9, YCoordinate=multiplication_8, ZCoordinate=panel_16)  # disabled
外周rotax = RotateAxis(Geometry=外周pt, Angle=number_slider_5, Axis=ln)  # -> Geometry, Transform; disabled
内周rotax = RotateAxis(Geometry=内周pt, Angle=number_slider_5, Axis=ln)  # -> Geometry, Transform; disabled
panel_19 = Panel(外周pt)  # disabled
panel_20 = Panel(内周pt)  # disabled
ln_2 = Line(StartPoint=内周pt, EndPoint=外周pt)  # disabled
ln_3 = Line(StartPoint=外周pt, EndPoint=外周rotax.Geometry)  # disabled
ln_4 = Line(StartPoint=内周pt, EndPoint=内周rotax.Geometry)  # disabled
ln_5 = Line(StartPoint=内周rotax.Geometry, EndPoint=外周rotax.Geometry)  # disabled
number_slider_6 = Slider(200, range=0..1000)  # disabled
panel_21 = Panel("""flattenがミソ！
あと、Shift押しながら繋ごう""")  # disabled
join = JoinCurves(Curves=flatten([ln_2, ln_4, ln_3, ln_5]), Preserve=False)  # disabled
boundary = BoundarySurfaces(Edges=join)  # disabled
Z = UnitZ(Factor=number_slider_6)  # disabled
extr = Extrude(Base=boundary, Direction=Z)  # disabled

size = Slider(8000, range=0..8000)  # disabled
entent = Slider(80, range=0..100)  # disabled
panel_22 = Panel("""-200000,0,0
0,-200000,0""")  # disabled
panel_23 = Panel("""200000,0,0
0,200000,0""")  # disabled
panel_24 = Panel("2")  # disabled
number_slider_7 = Slider(10, range=0..10)  # disabled
panel_25 = Panel("0,0,0")  # disabled
expression_9 = Expression(x=size, y=entent, Expression="-x*y/2")  # disabled
panel_26 = Panel("0")  # disabled
ln_6 = Line(StartPoint=panel_23, EndPoint=panel_22)  # disabled
pt_3 = Point(panel_25)  # disabled
division = Division(A=entent, B=panel_24)  # disabled
pt_4 = ConstructPoint(XCoordinate=expression_9, YCoordinate=expression_9, ZCoordinate=panel_26)  # disabled
arrrec = RectangularArray(
    Geometry=ln_6,
    Cell={Plane=PlaneXY(0, 0, 0), Size=Domain2(u=0..10, v=0..5)},
    XCount=number_slider_7,
    YCount=number_slider_7)  # -> Geometry, Transform; disabled
recgrid = Rectangular(Plane=pt_4, SizeX=size, SizeY=size, ExtentX=entent, ExtentY=entent)  # -> Cells, Points; disabled
multiplication_12 = Multiplication(A=size, B=division)  # disabled
cp = ControlPoints(Curve=arrrec.Geometry)  # -> Points, Weights, Knots; disabled
cp_2 = ControlPoints(Curve=recgrid.Cells)  # -> Points, Weights, Knots; disabled
dist = Distance(PointA=cp_2.Points, PointB=pt_3)  # disabled
panel_27 = Panel(dist)  # disabled
panel_28 = Panel("440000")  # disabled
panel_29 = Panel("0")  # disabled
subtraction = Subtraction(A=panel_27, B=panel_28)  # disabled
pt_5 = ConstructPoint(XCoordinate=panel_29, YCoordinate=panel_29, ZCoordinate=subtraction)  # disabled
panel_30 = Panel("")  # disabled
move = Move(Geometry=cp_2.Points, Motion=pt_5)  # -> Geometry, Transform; disabled
nurbs = NurbsCurve(Degree=3, Periodic=False)  # -> Curve, Length, Domain; disabled
curvepoint = PointOnCurve(parameter=0.728)  # disabled
subcrv = SubCurve()  # disabled

intcrv = Interpolate(Vertices=内周pt, Degree=3, Periodic=False, KnotStyle=1)  # -> Curve, Length, Domain; disabled
intcrv_2 = Interpolate(Vertices=外周pt, Degree=3, Periodic=False, KnotStyle=1)  # -> Curve, Length, Domain; disabled

rgb = ColourRGB(Alpha=255, Red=0, Green=0, Blue=0)
panel_32 = Panel("""0,0,10
0,10,10
0,20,10""")
panel_33 = Panel("""0,0,0
0,10,0
0,20,0""")
loft = Loft(Options={Adjust=False, Closed=False, LoftEnds=0, LoftSimp=0, LoftType=0, Rebuild=10, Refit=0.01})
swp1 = Sweep1(Miter=1)
extrude = ExtrudeLinear(OrientationP=PlaneXY(0, 0, 0))
viewer = ParamViewer(panel_33)
flatten = FlattenTree(Tree=panel_33, Path="{0}")
graft = GraftTree(Tree=panel_33, IncludeEmptyLists=True, IncludeNullItems=True)
simplify = SimplifyTree(Tree=panel_33, Front=False)
viewer_2 = ParamViewer(flatten)
viewer_3 = ParamViewer(simplify)
viewer_4 = ParamViewer(graft)
